# Grasshopper definition tester.ghx (Grasshopper 1.0.7)
# plug-ins: Human, Fologram For Grasshopper Utilities

number_slider = Slider(2, range=0..100)

trigger = Trigger(Interval=-1000, TimerInterval=1000, Target=C)  # disabled
C = Counter(Reset=Button())

moduleid = Slider(45, range=0..100)

# ---- group: Did you remeber to add the folding?
button = Button()

# ----
ghpython_script = GhPythonScript(module=moduleid, index=C, Write=Button(), Reset=Button(), GenFolding=button)  # -> ID, Blank, Planes, lines, text_frame, text_text, Counter; inputs module: Int32, index: Int32
# ---------- ghpython_script: Python ----------
from writehops import HOPSWriter, HOPSMerger, FrenchRidgeProcess, DoubleCutProcess, TextProcess, DoubleCutStepJointProcess
from parse_btlx import BTLXParser
from compas_rhino import unload_modules
import math
from compas_rhino.conversions import frame_to_rhino, point_to_rhino, line_to_rhino

from compas.geometry import Transformation, Frame, Point, Plane, Rotation, angle_vectors_signed, Vector, angle_vectors
from compas.geometry import Box, Line

import Rhino.Geometry as rg
import Grasshopper as gh
import os

from copy import deepcopy

unload_modules("writehops")
unload_modules("parse_btlx")

def get_hop_files_count(folder_path):
    hop_files = [file for file in os.listdir(folder_path) if file.endswith(".hop")]
    if len(hop_files) == 0:
        pass
    return len(hop_files)

# Get the path to the current Grasshopper file
current_gh_file_path = ghenv.Component.OnPingDocument().FilePath

# Ensure the current file path is valid
if current_gh_file_path:
    # Get the directory of the current Grasshopper file
    current_directory = os.path.dirname(current_gh_file_path)
    
    # Get the base directory (mas-t2-2324)
    base_directory = os.path.abspath(os.path.join(current_directory, '..', '..', 'mas-t2-2324'))
    
    # Define the new subdirectory relative path
    new_subdir = os.path.join('production', 'fabrication')
    
    # Construct the absolute path to the new directory
    new_path = os.path.join(base_directory, new_subdir)
    
    # Construct the folder and file name based on the integer index
    module_folder = "Module_{0}".format(module)
    module_btlx = "Module_{0}.btlx".format(module)
    
    # Construct the full path to the BTLx file, including the 'btlx' subdirectory
    btlx_file_path = os.path.join(new_path, module_folder, 'btlx', module_btlx)
#    btlx_file_path = os.path.join(current_directory, 'stepjoint.btlx')
    hops_file_path = os.path.join(new_path, module_folder, 'btlx',module_folder)
    # Print the constructed path
    
    # Check if the BTLx file exists
    if not os.path.isfile(btlx_file_path):
        print("The BTLx file '{0}' does not exist in the folder '{1}'.".format(module_btlx, os.path.join(new_path, module_folder, 'btlx')))
    else:
        print("The BTLx file path is correct.")
else:
    print("The Grasshopper file has not been saved yet. Please save it first.")


parser = BTLXParser(btlx_file_path)
remachining_dict = parser.get_remachining_dict()
text_dict = parser.get_text_dict()

keys = [key for key, value in remachining_dict.items()]

index = keys[index]
ID = "BeamID: " + str(index)

length = remachining_dict[str(index)]["length"]


hopper = HOPSWriter(length)
merger = HOPSMerger()
processes = []
geo = []
lines = []
Blank = Box.from_corner_corner_height([0,0,0], [length, 60,0], 60)
if len(text_dict[str(index)]["text"])>0:
    text =  text_dict[str(index)]["text"][0]
else:
    text = None
for machining in remachining_dict[str(index)]["machinings"]:
    if machining["Name"] == "French ridge lap":
        process = FrenchRidgeProcess(hopper, machining["face_front"], machining["ReferencePlaneID"])
        p = "frl"
    elif machining["Name"] == "T-Butt Joint":
        p = "dc"
        process = DoubleCutProcess(hopper, machining)
    elif machining["Name"] == "TStepJoint":
        p = "dcs"
        process = DoubleCutStepJointProcess(hopper, machining)
    if text:
        text_process = TextProcess(process.hopper, text, process.ref_orientation)
        text_frame = frame_to_rhino(text_process.frame)
        text_text = text_process.text
        ref =frame_to_rhino(text_process.ref_frame)
    processes.append(process)
    if p == "dc":
        geo.extend([process.cf1, process.cf2])
        lines.append(line_to_rhino(Line(*process.pts[:2])))
    elif p == "frl":
        geo.extend([process.frame1, process.frame2])
    elif p == "dcs":
        geo.extend([process.frame1, process.frame2])
        lines.append(line_to_rhino(Line(*process.pts[:2])))
        lines.append(line_to_rhino(Line(*process.pts[2:])))
hopper.generate_hops(processes)

Planes = []
for f in geo:
    if isinstance(f, Frame):
        Planes.append(frame_to_rhino(f))
    else:
        for frame in f:
            Planes.append(frame_to_rhino(frame))
#create folder with btlx name
filename = os.path.join(hops_file_path, "%s_.hop" % str(index).zfill(2))
if Write:
    hopper.write_to_file(file_path=filename)
    merger.merge_fabrication_files(hops_file_path, index)


folding_statement = " // GenFolding Pending"
if GenFolding:
    folding_statement = " // Lets make some SawDust!"
    file_count = get_hop_files_count(hops_file_path)
    for i in range(file_count-1):
        file_str = str(i).zfill(2) + ".hop"
        file_path = os.path.join(hops_file_path, file_str)
        if merger.add_centering_holes(file_path):
            print("Added centering holes to ", file_str)
        else:
            print("No centering holes added to ", file_str)


#counter
if "count" not in globals() or Reset:
    count = 0
if Write and not Reset:
    count +=1
Counter = "NewHopFiles: " + str(get_hop_files_count(hops_file_path)) + "/" + str(len(keys)) + folding_statement
# ---------- end ghpython_script ----------
beamid = Panel(ghpython_script.ID)
counter = Panel(ghpython_script.Counter)
curve = Curve(ghpython_script.lines)
pln = Plane(ghpython_script.Planes)

custom_preview_lineweights = CustomPreviewLineweights(
    Geometry=graft(ghpython_script.lines),
    Shader=graft(ColourSwatch(SwatchColor=RGB(234, 255, 0))),
    Thickness=Slider(3.3, range=0..10),
    Absolute=False)

text_tag_3d = TextTag3D(
    Location=ghpython_script.text_frame,
    Text=ghpython_script.text_text,
    Size=Slider(19, range=0..100),
    Colour=ColourSwatch(SwatchColor=RGB(0, 250, 42)),
    Justification=7)

draw = Draw(cg=ghpython_script.Blank)  # -> rg
#   port cg: The COMPAS geometry or datastructure to be drawn.
#   port rg: The Rhino geometry object.
# ---------- draw: Python ----------
"""
Draws COMPAS geometry in Grasshopper.
"""
from ghpythonlib.componentbase import executingcomponent as component

from compas.scene import SceneObject


class CompasToRhinoGeometry(component):
    def RunScript(self, cg):
        if not cg:
            return None

        return SceneObject(cg).draw()
# ---------- end draw ----------
pln_2 = Plane(ghpython_script.Planes)
cluster = Cluster(bool=Toggle(True), brep=draw, plane=pln_2)  # -> crv_2, s_1

# ==== cluster Cluster
brep = ClusterInput()
plane = ClusterInput()
plane_2 = Plane(plane)
brep_2 = Brep(brep)
plane_3 = Plane(plane)
brep_3 = Brep(brep)
deplane = DeconstructPlane(Plane=plane_2)  # -> Origin, XAxis, YAxis, ZAxis
partition = PartitionList(List=plane_2, Size=Slider(2, range=0..10))
debrep = DeconstructBrep(Brep=brep_3)  # -> Faces, Edges, Vertices
debrep_2 = DeconstructBrep(Brep=brep_2)  # -> Faces, Edges, Vertices
abs = Absolute(Value=deplane.ZAxis)
shift = ShiftList(List=abs, Shift=1, Wrap=True)
sec = BrepPlane(Brep=brep_3, Plane=partition)  # -> Curves, Points
cullpt = CullDuplicates(Points=deplane.Origin, Tolerance=0.1, CullMode=3)  # -> Points, Indices, Valence
sort = SortList(Keys=debrep.Faces, ValuesA=debrep.Faces)  # -> Keys, ValuesA
sort_2 = SortList(Keys=debrep_2.Faces, ValuesA=debrep_2.Faces)  # -> Keys, ValuesA
trim = TrimTree(Tree=sec.Curves, Depth=1)
xprod = CrossProduct(VectorA=abs, VectorB=shift, Unitize=False)  # -> Vector, Length
dprod = DotProduct(VectorA=abs, VectorB=xprod.Vector, Unitize=False)
item = ListItem(List=sort.ValuesA, Index=0, Wrap=True)  # -> Item, Item1
item_2 = ListItem(List=sort_2.ValuesA, Index=0, Wrap=True)  # -> Item, Item1
dispatch = Dispatch(List=trim, DispatchPattern=[True, False])  # -> ListA, ListB
equals = Equality(FirstNumber=dprod, SecondNumber="4")  # -> Equality, Inequality
ccx = CurveCurve(CurveA=dispatch.ListA, CurveB=dispatch.ListB)  # -> Points, ParamsA, ParamsB
ma = MassAddition(Input=equals.Equality)  # -> Result, PartialResults
offset = OffsetSurface(Surface=[item.Item, item.Item1], Distance=expr("-x", Slider(60, range=0..100)), Retrim=True)
shatter = Shatter(Curve=dispatch.ListB, Parameters=ccx.ParamsB)
shatter_2 = Shatter(Curve=dispatch.ListA, Parameters=ccx.ParamsA)
dispatch_2 = Dispatch(List=plane_2, DispatchPattern=[True, False])  # -> ListA, ListB
pln = Plane(offset)
item_3 = ListItem(List=shatter_2, Index=0, Wrap=True)
item_4 = ListItem(List=shatter, Index=0, Wrap=True)
entwine = Entwine(Branch00=dispatch_2.ListA, Branch01=pln, FlattenInputs=True)
connect = ConnectCurves(Curves=item_3, Continuity=0, Close=True, Bulge=1)
brep_plane = BrepPlane(Brep=brep_3, Plane=entwine)  # -> Curves, Points
center = Center(Geometry=shatter_2)  # -> Center, Dimension
center_2 = Center(Geometry=brep_3)  # -> Center, Dimension
center_3 = Center(Geometry=shatter)  # -> Center, Dimension
center_4 = Center(Geometry=brep_3)  # -> Center, Dimension
trim_2 = TrimTree(Tree=brep_plane.Curves, Depth=1)
dist = Distance(PointA=center_2.Center, PointB=center.Center)
dist_2 = Distance(PointA=center_4.Center, PointB=center_3.Center)
flip = FlipMatrix(Data=trim_2)
dispatch_3 = Dispatch(List=flip, DispatchPattern=[True, False])  # -> ListA, ListB
sort_3 = SortList(Keys=dist, ValuesA=shatter_2)  # -> Keys, ValuesA
sort_4 = SortList(Keys=dist_2, ValuesA=shatter)  # -> Keys, ValuesA
bool = ClusterInput()
filter = StreamFilter(Gate=bool, Stream0=plane_3, Stream1=reverse(plane_3))
brep_plane_2 = BrepPlane(Brep=brep_2, Plane=filter)  # -> Curves, Points
dispatch_4 = Dispatch(List=flatten(brep_plane_2.Curves), DispatchPattern=[True, False])  # -> ListA, ListB
ccx_2 = CurveCurve(CurveA=dispatch_4.ListA, CurveB=dispatch_4.ListB)  # -> Points, ParamsA, ParamsB
entwine_2 = Entwine(Branch00=ccx_2.ParamsA, Branch01=ccx_2.ParamsB, FlattenInputs=True)
shatter_3 = Shatter(Curve=brep_plane_2.Curves, Parameters=entwine_2)
trim_3 = TrimTree(Tree=shatter_3, Depth=1)
bang = ExplodeTree(Data=trim_3)  # -> Branch0, Branch1
item_5 = ListItem(List=reverse(bang.Branch1), Index=0, Wrap=True)
item_6 = ListItem(List=bang.Branch1, Index=0, Wrap=True)
item_7 = ListItem(List=reverse(bang.Branch0), Index=0, Wrap=True)
connect_2 = ConnectCurves(Curves=item_5, Continuity=0, Close=True, Bulge=1)
item_8 = ListItem(List=bang.Branch0, Index=0, Wrap=True)
connect_3 = ConnectCurves(Curves=item_7, Continuity=0, Close=True, Bulge=1)
connect_4 = ConnectCurves(Curves=item_6, Continuity=0, Close=True, Bulge=1)
pln_2 = Plane(connect_2)
pln_3 = Plane(connect_4)
deplane_2 = DeconstructPlane(Plane=pln_2)  # -> Origin, XAxis, YAxis, ZAxis
deplane_3 = DeconstructPlane(Plane=pln_3)  # -> Origin, XAxis, YAxis, ZAxis
merge = Merge(Data1=flatten(connect_3), Data2=flatten(connect_4))
angle = Angle(VectorA=deplane_3.ZAxis, VectorB=deplane_2.ZAxis)  # -> Angle, Reflex
boundary = BoundarySurfaces(Edges=merge)
ccx_3 = CurveCurve(CurveA=dispatch_3.ListA, CurveB=dispatch_3.ListB)  # -> Points, ParamsA, ParamsB
shatter_4 = Shatter(Curve=dispatch_3.ListB, Parameters=ccx_3.ParamsB)
item_9 = ListItem(List=sort_3.ValuesA, Index=0, Wrap=True)
bool_2 = Boolean(bool)
item_10 = ListItem(List=sort_4.ValuesA, Index=0, Wrap=True)
deg = Degrees(Radians=angle.Angle)
join = BrepJoin(Breps=boundary)  # -> Breps, Closed
bang_2 = ExplodeTree(Data=shatter_4)  # -> Branch0, Branch1
shatter_5 = Shatter(Curve=dispatch_3.ListA, Parameters=ccx_3.ParamsA)
connect_5 = ConnectCurves(Curves=item_9, Continuity=0, Close=True, Bulge=1)
connect_6 = ConnectCurves(Curves=item_10, Continuity=0, Close=True, Bulge=1)
split = SplitBrep(Brep=brep_2, Cutter=join.Breps)
filter_2 = StreamFilter(Gate=bool_2, Stream0=reverse(bang_2.Branch0), Stream1=bang_2.Branch0)
filter_3 = StreamFilter(Gate=bool_2, Stream0=reverse(bang_2.Branch1), Stream1=bang_2.Branch1)
bang_3 = ExplodeTree(Data=shatter_5)  # -> Branch0, Branch1
sort_5 = SortList(Keys=split, ValuesA=split)  # -> Keys, ValuesA
boundary_2 = BoundarySurfaces(Edges=[connect_5, connect_6])
item_11 = ListItem(List=reverse(bang_3.Branch0), Index=0, Wrap=True)
item_12 = ListItem(List=reverse(filter_3), Index=0, Wrap=True)
item_13 = ListItem(List=bang_3.Branch1, Index=0, Wrap=True)
item_14 = ListItem(List=filter_2, Index=0, Wrap=True)
item_15 = ListItem(List=reverse(sort_5.ValuesA), Index=0, Wrap=True)
join_2 = BrepJoin(Breps=flatten(boundary_2))  # -> Breps, Closed
join_3 = BrepJoin(Breps=flatten([boundary, item_15]))  # -> Breps, Closed
splitmul = SplitBrepMultiple(Brep=brep_3, Cutters=join_2.Breps)
brep_4 = Brep(join_3.Breps)
sort_6 = SortList(Keys=splitmul, ValuesA=splitmul)  # -> Keys, ValuesA
connect_7 = ConnectCurves(Curves=graft([item_13, item_12]), Continuity=0, Close=True, Bulge=1)
connect_8 = ConnectCurves(Curves=graft([item_11, item_14]), Continuity=0, Close=True, Bulge=1)
crv = Curve(flatten([connect_7, connect_8]))
lng = ListLength(List=splitmul)
item_16 = ListItem(List=reverse(sort_6.ValuesA), Index=0, Wrap=True)
crv_2 = ClusterOutput(crv)
boundary_3 = BoundarySurfaces(Edges=flatten(connect_7))
boundary_4 = BoundarySurfaces(Edges=flatten(connect_8))
larger = LargerThan(FirstNumber=lng, SecondNumber=Slider(3, range=0..10))  # -> LargerThan, OrEqualTo
join_4 = BrepJoin(Breps=boundary_3)  # -> Breps, Closed
join_5 = BrepJoin(Breps=flatten([item_16, boundary_2]))  # -> Breps, Closed
join_6 = BrepJoin(Breps=boundary_4)  # -> Breps, Closed
merge_2 = Merge(Data1=join_6.Breps, Data2=join_4.Breps)
filter_4 = StreamFilter(Gate=larger.OrEqualTo, Stream0=brep_4, Stream1=join_5.Breps)
splitmul_2 = SplitBrepMultiple(Brep=brep_3, Cutters=merge_2)
sort_7 = SortList(Keys=splitmul_2, ValuesA=splitmul_2)  # -> Keys, ValuesA
item_17 = ListItem(List=reverse(sort_7.ValuesA), Index=0, Wrap=True)
null = NullItem(Item=crv)  # -> NullFlags, InvalidFlags, Description
join_7 = BrepJoin(Breps=flatten([item_17, join_6.Breps, join_4.Breps]))  # -> Breps, Closed
filter_5 = StreamFilter(Gate=null.NullFlags, Stream0=join_7.Breps, Stream1=filter_4)
s_1 = ClusterOutput(filter_5)
