# Grasshopper definition tester.ghx (Grasshopper 1.0.7)
# plug-ins: Human

moduleid = Slider(44, range=0..100)
ghpython_script = GhPythonScript(module=moduleid, index=Slider(4, range=0..100), Write=Button(), Reset=Button())  # -> log, box, rg, text_frame, text_text, ref, lines, Counter; inputs module: Int32, index: Int32
# ---------- ghpython_script: Python ----------
from writehops import HOPSWriter, HOPSMerger, FrenchRidgeProcess, DoubleCutProcess, TextProcess, DoubleCutStepJointProcess
from parse_btlx import BTLXParser
from compas_rhino import unload_modules
import math
from compas_rhino.conversions import frame_to_rhino, point_to_rhino, line_to_rhino

from compas.geometry import Transformation, Frame, Point, Plane, Rotation, angle_vectors_signed, Vector, angle_vectors
from compas.geometry import Box, Line

import Rhino.Geometry as rg
import Grasshopper as gh
import os

from copy import deepcopy

unload_modules("writehops")
unload_modules("parse_btlx")

# Get the path to the current Grasshopper file
current_gh_file_path = ghenv.Component.OnPingDocument().FilePath

# Ensure the current file path is valid
if current_gh_file_path:
    # Get the directory of the current Grasshopper file
    current_directory = os.path.dirname(current_gh_file_path)
    
    # Get the base directory (mas-t2-2324)
    base_directory = os.path.abspath(os.path.join(current_directory, '..', '..', 'mas-t2-2324'))
    
    # Define the new subdirectory relative path
    new_subdir = os.path.join('production', 'fabrication')
    
    # Construct the absolute path to the new directory
    new_path = os.path.join(base_directory, new_subdir)
    
    # Construct the folder and file name based on the integer index
    module_folder = "Module_{0}_test".format(module)
    module_btlx = "Module_{0}_test.btlx".format(module)
    
    # Construct the full path to the BTLx file, including the 'btlx' subdirectory
    btlx_file_path = os.path.join(new_path, module_folder, 'btlx', module_btlx)
#    btlx_file_path = os.path.join(current_directory, 'stepjoint.btlx')
    hops_file_path = os.path.join(new_path, module_folder, 'btlx',module_folder)
    print(hops_file_path)
    # Print the constructed path
    
    # Check if the BTLx file exists
    if not os.path.isfile(btlx_file_path):
        print("The BTLx file '{0}' does not exist in the folder '{1}'.".format(module_btlx, os.path.join(new_path, module_folder, 'btlx')))
    else:
        print("The BTLx file path is correct.")
else:
    print("The Grasshopper file has not been saved yet. Please save it first.")


parser = BTLXParser(btlx_file_path)
remachining_dict = parser.get_remachining_dict()
text_dict = parser.get_text_dict()

keys = [key for key, value in remachining_dict.items()]

index = keys[index]
log = str(index) + " of %s" % str(len(keys)) + " pieces"

length = remachining_dict[str(index)]["length"]


hopper = HOPSWriter(length)
merger = HOPSMerger()
processes = []
geo = []
lines = []
box = Box.from_corner_corner_height([0,0,0], [length, 60,0], 60)
print remachining_dict[str(index)]
if len(text_dict[str(index)]["text"])>0:
    text =  text_dict[str(index)]["text"][0]
else:
    text = None
for machining in remachining_dict[str(index)]["machinings"]:
    if machining["Name"] == "French ridge lap":
        process = FrenchRidgeProcess(hopper, machining["face_front"], machining["ReferencePlaneID"])
        p = "frl"
    elif machining["Name"] == "T-Butt Joint":
        p = "dc"
        process = DoubleCutProcess(hopper, machining)
    elif machining["Name"] == "Stepjoint":
        p = "dcs"
        process = DoubleCutStepJointProcess(hopper, machining)
        print process.ref_orientation
#    print process.
    if text:
        text_process = TextProcess(process.hopper, text, process.ref_orientation)
        text_frame = frame_to_rhino(text_process.frame)
        text_text = text_process.text
        ref =frame_to_rhino(text_process.ref_frame)
    processes.append(process)
    if p == "dc":
        geo.extend([process.cf1, process.cf2])
        lines.append(line_to_rhino(Line(*process.pts)))
    elif p == "frl":
        geo.extend([process.frame1, process.frame2])
    elif p == "dcs":
        geo.extend([process.cf1, process.cf2])
        lines.append(line_to_rhino(Line(*process.pts)))
hopper.generate_hops(processes)

rg = []
for f in geo:
    if isinstance(f, Frame):
        rg.append(frame_to_rhino(f))
    else:
        for frame in f:
            rg.append(frame_to_rhino(frame))
#create folder with btlx name
filename = os.path.join(hops_file_path, "%s_.hop" % str(index).zfill(2))
print(filename)
if Write:
    hopper.write_to_file(file_path=filename)
    merger.merge_fabrication_files(hops_file_path, index)

#counter
if "count" not in globals() or Reset:
    count = 0
if Write and not Reset:
    count +=1
Counter = "RegeneratedFiles: " + str(count)
# ---------- end ghpython_script ----------
beam_index = Panel(ghpython_script.log)
counter = Panel(ghpython_script.Counter)

custom_preview_lineweights = CustomPreviewLineweights(
    Geometry=graft(ghpython_script.lines),
    Shader=graft(ColourSwatch(SwatchColor=RGB(234, 255, 0))),
    Thickness=Slider(3.3, range=0..10),
    Absolute=False)

text_tag_3d = TextTag3D(
    Location=ghpython_script.text_frame,
    Text=ghpython_script.text_text,
    Size=Slider(19, range=0..100),
    Colour=ColourSwatch(SwatchColor=RGB(0, 250, 42)),
    Justification=7)

draw = Draw(cg=ghpython_script.box)  # -> rg
#   port cg: The COMPAS geometry or datastructure to be drawn.
#   port rg: The Rhino geometry object.
# ---------- draw: Python ----------
"""
Draws COMPAS geometry in Grasshopper.
"""
from ghpythonlib.componentbase import executingcomponent as component

from compas.scene import SceneObject


class CompasToRhinoGeometry(component):
    def RunScript(self, cg):
        if not cg:
            return None

        return SceneObject(cg).draw()
# ---------- end draw ----------
pln = Plane(ghpython_script.rg)
cluster = Cluster(bool=Toggle(True), brep=draw, plane=pln)  # -> crv_2, s_0, R

# ==== cluster Cluster
brep = ClusterInput()
plane = ClusterInput()
plane_2 = Plane(plane)
brep_2 = Brep(brep)
plane_3 = Plane(plane)
brep_3 = Brep(brep)
debrep = DeconstructBrep(Brep=brep_3)  # -> Faces, Edges, Vertices
debrep_2 = DeconstructBrep(Brep=brep_2)  # -> Faces, Edges, Vertices
sort = SortList(Keys=debrep.Faces, ValuesA=debrep.Faces)  # -> Keys, ValuesA
sort_2 = SortList(Keys=debrep_2.Faces, ValuesA=debrep_2.Faces)  # -> Keys, ValuesA
item = ListItem(List=sort.ValuesA, Index=0, Wrap=True)  # -> Item, Item1
item_2 = ListItem(List=sort_2.ValuesA, Index=0, Wrap=True)  # -> Item, Item1
offset = OffsetSurface(Surface=[item.Item, item.Item1], Distance=expr("-x", Slider(60, range=0..100)), Retrim=True)
dispatch = Dispatch(List=plane_2, DispatchPattern=[True, False])  # -> ListA, ListB
pln = Plane(offset)
entwine = Entwine(Branch00=dispatch.ListA, Branch01=pln, FlattenInputs=True)
brep_plane = BrepPlane(Brep=brep_3, Plane=entwine)  # -> Curves, Points
trim = TrimTree(Tree=brep_plane.Curves, Depth=1)
flip = FlipMatrix(Data=trim)
dispatch_2 = Dispatch(List=flip, DispatchPattern=[True, False])  # -> ListA, ListB
bool = ClusterInput()
filter = StreamFilter(Gate=bool, Stream0=plane_3, Stream1=reverse(plane_3))
brep_plane_2 = BrepPlane(Brep=brep_2, Plane=filter)  # -> Curves, Points
dispatch_3 = Dispatch(List=flatten(brep_plane_2.Curves), DispatchPattern=[True, False])  # -> ListA, ListB
ccx = CurveCurve(CurveA=dispatch_3.ListA, CurveB=dispatch_3.ListB)  # -> Points, ParamsA, ParamsB
entwine_2 = Entwine(Branch00=ccx.ParamsA, Branch01=ccx.ParamsB, FlattenInputs=True)
shatter = Shatter(Curve=brep_plane_2.Curves, Parameters=entwine_2)
trim_2 = TrimTree(Tree=shatter, Depth=1)
bang = ExplodeTree(Data=trim_2)  # -> Branch0, Branch1
item_3 = ListItem(List=reverse(bang.Branch1), Index=0, Wrap=True)
item_4 = ListItem(List=bang.Branch1, Index=0, Wrap=True)
item_5 = ListItem(List=reverse(bang.Branch0), Index=0, Wrap=True)
connect = ConnectCurves(Curves=item_3, Continuity=0, Close=True, Bulge=1)
item_6 = ListItem(List=bang.Branch0, Index=0, Wrap=True)
connect_2 = ConnectCurves(Curves=item_5, Continuity=0, Close=True, Bulge=1)
connect_3 = ConnectCurves(Curves=item_4, Continuity=0, Close=True, Bulge=1)
pln_2 = Plane(connect)
pln_3 = Plane(connect_3)
deplane = DeconstructPlane(Plane=pln_2)  # -> Origin, XAxis, YAxis, ZAxis
deplane_2 = DeconstructPlane(Plane=pln_3)  # -> Origin, XAxis, YAxis, ZAxis
merge = Merge(Data1=flatten(connect_2), Data2=flatten(connect_3))
angle = Angle(VectorA=deplane_2.ZAxis, VectorB=deplane.ZAxis)  # -> Angle, Reflex
boundary = BoundarySurfaces(Edges=merge)
R = ClusterOutput(merge)
ccx_2 = CurveCurve(CurveA=dispatch_2.ListA, CurveB=dispatch_2.ListB)  # -> Points, ParamsA, ParamsB
shatter_2 = Shatter(Curve=dispatch_2.ListB, Parameters=ccx_2.ParamsB)
bool_2 = Boolean(bool)
deg = Degrees(Radians=angle.Angle)
join = BrepJoin(Breps=boundary)  # -> Breps, Closed
bang_2 = ExplodeTree(Data=shatter_2)  # -> Branch0, Branch1
shatter_3 = Shatter(Curve=dispatch_2.ListA, Parameters=ccx_2.ParamsA)
split = SplitBrep(Brep=brep_2, Cutter=join.Breps)
filter_2 = StreamFilter(Gate=bool_2, Stream0=reverse(bang_2.Branch0), Stream1=bang_2.Branch0)
filter_3 = StreamFilter(Gate=bool_2, Stream0=reverse(bang_2.Branch1), Stream1=bang_2.Branch1)
bang_3 = ExplodeTree(Data=shatter_3)  # -> Branch0, Branch1
sort_3 = SortList(Keys=split, ValuesA=split)  # -> Keys, ValuesA
item_7 = ListItem(List=reverse(bang_3.Branch0), Index=0, Wrap=True)
item_8 = ListItem(List=reverse(filter_3), Index=0, Wrap=True)
item_9 = ListItem(List=bang_3.Branch1, Index=0, Wrap=True)
item_10 = ListItem(List=filter_2, Index=0, Wrap=True)
item_11 = ListItem(List=reverse(sort_3.ValuesA), Index=0, Wrap=True)
join_2 = BrepJoin(Breps=flatten([boundary, item_11]))  # -> Breps, Closed
brep_4 = Brep(join_2.Breps)
connect_4 = ConnectCurves(Curves=graft([item_9, item_8]), Continuity=0, Close=True, Bulge=1)
connect_5 = ConnectCurves(Curves=graft([item_7, item_10]), Continuity=0, Close=True, Bulge=1)
crv = Curve(flatten([connect_4, connect_5]))
crv_2 = ClusterOutput(crv)
boundary_2 = BoundarySurfaces(Edges=flatten(connect_4))
boundary_3 = BoundarySurfaces(Edges=flatten(connect_5))
join_3 = BrepJoin(Breps=boundary_2)  # -> Breps, Closed
join_4 = BrepJoin(Breps=boundary_3)  # -> Breps, Closed
merge_2 = Merge(Data1=join_4.Breps, Data2=join_3.Breps)
splitmul = SplitBrepMultiple(Brep=brep_3, Cutters=merge_2)
sort_4 = SortList(Keys=splitmul, ValuesA=splitmul)  # -> Keys, ValuesA
item_12 = ListItem(List=reverse(sort_4.ValuesA), Index=0, Wrap=True)
lng = ListLength(List=plane)
larger = LargerThan(FirstNumber=lng, SecondNumber=Slider(2, range=0..10))  # -> LargerThan, OrEqualTo
join_5 = BrepJoin(Breps=flatten([item_12, join_4.Breps, join_3.Breps]))  # -> Breps, Closed
filter_4 = StreamFilter(Gate=larger.LargerThan, Stream0=join_2.Breps, Stream1=join_5.Breps)
s_0 = ClusterOutput(filter_4)
